% Simulink data dictionary ACM4010.sldd

J = Simulink.Parameter(6.0e-6, StorageClass="Struct", StructName="Motor_Parameter", DataType="single")
Pn = Simulink.Parameter(5, StorageClass="Struct", StructName="Motor_Parameter", DataType="single")
Rs = Simulink.Parameter(0.28, StorageClass="Struct", StructName="Motor_Parameter", DataType="single")
Ld = Simulink.Parameter(0.0002, StorageClass="Struct", StructName="Motor_Parameter", DataType="single")
currentKi = Simulink.Parameter(1.5, StorageClass="Struct", StructName="PI_Current", DataType="single")
Ki_spd = Simulink.Parameter(0.06, DataType="single")
Kp_spd = Simulink.Parameter(0.025, DataType="single")
currentKp = Simulink.Parameter(3.5, StorageClass="Struct", StructName="PI_Current", DataType="single")
Lq = Simulink.Parameter(0.0002, StorageClass="Struct", StructName="Motor_Parameter", DataType="single")
flux = Simulink.Parameter(0.006, StorageClass="Struct", StructName="Motor_Parameter", DataType="single")